# Grasshopper definition test-simplified-copy-ordered.ghx (Grasshopper 0.9.76)

# ---- group: groupsingle
deg = Slider(180, range=0..1000)

# ----
vec = VectorXYZ()  # -> Vector, Length
x = Slider(6, range=0..10)
y = Slider(1, range=0..1)
z = Slider(5, range=0..10)
yz = YZPlane(Origin=vec.Vector)
degrad = Radians(Degrees=deg)
toggle = BooleanToggle(False)

# ---- group: uuuuu
cir = Circle(Plane=yz, Radius=degrad)
pt = ConstructPoint(XCoordinate=x, YCoordinate=y, ZCoordinate=z)

# ----
scale = Scale(Geometry=cir, Factor=y)  # -> Geometry, Transform
scale2 = Scale(Geometry=cir, Factor=x)  # -> Geometry, Transform

panel = Panel("aaaaaaa")
panel_2 = Panel([scale2.Geometry, scale2.Transform])
panel_3 = Panel(scale2.Transform)
