# Grasshopper definition simple-cube.ghx (Grasshopper 0.9.76)

x_origin = Slider(0, range=0..1)
y_origin = Slider(0, range=0..10)
z_origin = Slider(0, range=0..10)
cube_size = Slider(4, range=0..10)
addition = Addition(A=z_origin, B=cube_size)
addition_2 = Addition(A=y_origin, B=cube_size)
addition_3 = Addition(A=x_origin, B=cube_size)
pt = ConstructPoint(XCoordinate=addition_3, YCoordinate=addition_2, ZCoordinate=addition)
pt_2 = ConstructPoint(XCoordinate=x_origin, YCoordinate=y_origin, ZCoordinate=z_origin)
box = Box2Pt(PointA=pt_2, PointB=pt, Plane=PlaneXY(0, 0, 0))
mesh = MeshBrep(
    Brep=box,
    Settings={GridMaxCount=0, GridMinCount=16, JaggedSeams=False, MaxEdgeLength=0, MinEdgeLength=0.0001, MinTolerance=0, Refine=True, RefineAngle=0, RelativeTolerance=0.65, SimplePlanes=True, Tolerance=0})
