# Grasshopper definition test - Copie.ghx (Grasshopper 0.9.76)

deg = Slider(180, range=0..1000)
x = Slider(5, range=1..11)
y = Slider(1, range=0..1)
z = Slider(5, range=0..10)
yz = YZPlane(Origin=Point(0, 0, 0))
degrad = Radians(Degrees=deg)
move = Move(Motion=Vector(0, 0, 10))  # -> Geometry, Transform
cir = Circle(Plane=yz, Radius=degrad)
pt = ConstructPoint(XCoordinate=x, YCoordinate=y, ZCoordinate=z)
toggle = BooleanToggle(True)
number_slider = Slider(0.25, range=0..1)
scale = Scale(Geometry=cir, Center=Point(0, 0, 0), Factor=y)  # -> Geometry, Transform
scale2 = Scale(Geometry=cir, Center=Point(0, 0, 0), Factor=x)  # -> Geometry, Transform
panel = Panel([scale2.Geometry, scale2.Transform])
panel_2 = Panel(scale2.Transform)
