# Grasshopper definition test-copy.ghx (Grasshopper 0.9.76)

x_origin = Slider(4, range=0..4)
y_origin = Slider(4, range=0..4)
z_origin = Slider(4, range=0..4)
x_origin_2 = Slider(0, range=0..1)
y_origin_2 = Slider(0, range=0..10)
z_origin_2 = Slider(0, range=0..10)
pt = ConstructPoint(XCoordinate=x_origin, YCoordinate=y_origin, ZCoordinate=z_origin)
pt_2 = ConstructPoint(XCoordinate=x_origin_2, YCoordinate=y_origin_2, ZCoordinate=z_origin_2)
box = Box2Pt(PointA=pt_2, PointB=pt, Plane=PlaneXY(0, 0, 0))
mesh = MeshBrep(
    Brep=box,
    Settings={GridMaxCount=0, GridMinCount=16, JaggedSeams=False, MaxEdgeLength=0, MinEdgeLength=0.0001, MinTolerance=0, Refine=True, RefineAngle=0, RelativeTolerance=0.65, SimplePlanes=True, Tolerance=0})
xy = XYPlane(Origin=Point(0, 0, 0))
move = Move(Geometry=box, Motion=Vector(0, 0, 10))  # -> Geometry, Transform
rad = Radians(Degrees=Slider(130, range=0..1000))
rotate = Rotate(Geometry=move.Geometry, Angle=rad, Plane=xy)  # -> Geometry, Transform
mesh_2 = MeshBrep(
    Brep=rotate.Geometry,
    Settings={GridMaxCount=0, GridMinCount=16, JaggedSeams=False, MaxEdgeLength=0, MinEdgeLength=0.0001, MinTolerance=0, Refine=True, RefineAngle=0, RelativeTolerance=0.65, SimplePlanes=True, Tolerance=0})
meshsteaming = CSharpScript(mesh=mesh_2)  # inputs mesh: Mesh
# ---------- meshsteaming: C# ----------
using(var args = new Rhino.Runtime.NamedParametersEventArgs())
{
args.Set("mesh", mesh);
Rhino.Runtime.HostUtils.ExecuteNamedCallback("Unity:FromGrasshopper", args);
}
# ---------- end meshsteaming ----------
