# Grasshopper definition test.ghx (Grasshopper 0.9.76)

deg = Slider(180, range=0..1000)
x = Slider(6, range=0..10)
y = Slider(1, range=0..1)
z = Slider(5, range=0..10)
yz = YZPlane(Origin=Point(0, 0, 0))
degrad = Radians(Degrees=deg)
move = Move(Motion=Vector(0, 0, 10))  # -> Geometry, Transform
toggle = BooleanToggle(True)

# ---- group: uuuuu
cir = Circle(Plane=yz, Radius=degrad)
pt = ConstructPoint(XCoordinate=x, YCoordinate=y, ZCoordinate=z)

# ----
number_slider = Slider(0.25, range=0..1)

scale = Scale(Geometry=cir, Center=Point(0, 0, 0), Factor=y)  # -> Geometry, Transform
scale2 = Scale(Geometry=cir, Center=Point(0, 0, 0), Factor=x)  # -> Geometry, Transform

second_cluster = SecondCluster(x=Slider(0.25, range=0..1))
panel = Panel([scale2.Geometry, scale2.Transform])
panel_2 = Panel(scale2.Transform)
panel_3 = Panel(second_cluster)
first_cluster = FirstCluster(
    X=Slider(0.25, range=0..1),
    Y=Slider(0.25, range=0..1),
    Z=Slider(0.25, range=0..1),
    X_2=Slider(0.25, range=0..1),
    Y_2=Slider(0.25, range=0..1),
    Z_2=Slider(0.25, range=0..1))
geo = Geometry(first_cluster)

# ==== cluster FirstCluster
X = ClusterInput()
Y = ClusterInput()
Z = ClusterInput()
X_2 = ClusterInput()
Y_2 = ClusterInput()
Z_2 = ClusterInput()
pt = ConstructPoint(XCoordinate=X, YCoordinate=Y, ZCoordinate=Z)
pt_2 = ConstructPoint(XCoordinate=X_2, YCoordinate=Y_2, ZCoordinate=Z_2)
rotate = Rotate(Geometry=pt, Center=pt_2, From=Vector(1, 0, 0), To=Vector(0, 1, 0))  # -> Geometry, Transform
G = ClusterOutput(rotate.Geometry)

# ==== cluster SecondCluster
x = ClusterInput()
abs = Absolute(Value=x)
sqr = Square(Value=abs)
y = ClusterOutput(sqr)
